# Grasshopper definition #39-GeomConvAndVisualiz-afterAdapterAlignment.gh (Grasshopper 1.0.7)
# plug-ins: UserDataUtils, BH.UI.Grasshopper

Y = UnitY(Factor=Slider(2, range=0..10))
line = Line(Line((0, -5, 0), (0, -5, 10)))

# ----
# Elements to push
pop3d = Populate3D(Region={Plane=PlaneXY(0, 0, 0), X=Domain(0, 10), Y=Domain(0, 10), Z=Domain(0, 2)}, Count=100, Seed=1)
bbox = BoundingBox(Content=pop3d, Plane=PlaneXY(0, 0, 0), UnionBox=True)  # -> Box, Box_2
smesh = SimpleMesh(Brep=bbox.Box)
demesh = DeconstructMesh(Mesh=smesh)  # -> Vertices, Faces, Colours, Normals
mesh = Mesh(Vertices=demesh.Vertices, Faces=demesh.Faces, Component="{ .Mesh")

line_2 = Line(Line((0, -5, 10), (0, 5, 10)))
line_3 = Line(Line((0, 5, 0), (0, 5, 10)))
pt = Data(Point(13, -2, 0))
line_4 = Line([Line((0, -5, 10), (0, 5, 0)), Line((0, -5, 0), (0, 5, 10))])
move = Move(Geometry=line_4, Motion=Vector(0, 0, 10))  # -> Geometry, Transform
chs = CHS(
    {"CHS 21.3x2.6": 0, "CHS 21.3x2.9": 1, "CHS 21.3x3.2": 2, "CHS 26.9x2.6": 3, "CHS 26.9x2.9": 4, "CHS 26.9x3.2": 5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}, selected="CHS 76.1x5.6": 45,
    Component="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",
    Selection=45)
uc = UC(
    {"UC 356x406x1299": 0, "UC 356x406x1202": 1, "UC 356x406x1086": 2, "UC 356x406x990": 3, "UC 356x406x900": 4, "UC 356x406x818": 5, "UC 356x406x744": 6, "UC 356x406x677": 7, "UC 356x406x634": 8, "UC 356x406x592": 9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}, selected="UC 356x406x1086",
    Component="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",
    Selection=2)
L = L(
    {"L 200x150x18.0": 0, "L 200x150x15.0": 1, "L 200x150x12.0": 2, "L 200x100x15.0": 3, "L 200x100x12.0": 4, "L 200x100x10.0": 5, "L 150x90x15.0": 6, "L 150x90x12.0": 7, "L 150x90x10.0": 8, "L 150x75x15.0": 9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}, selected="L 200x150x18.0",
    Component="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",
    Selection=0)
uc_2 = UC(
    {"UC 356x406x1299": 0, "UC 356x406x1202": 1, "UC 356x406x1086": 2, "UC 356x406x990": 3, "UC 356x406x900": 4, "UC 356x406x818": 5, "UC 356x406x744": 6, "UC 356x406x677": 7, "UC 356x406x634": 8, "UC 356x406x592": 9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}, selected="UC 356x406x1086",
    Component="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",
    Selection=2)
ub = UB(
    {"UB 1016x305x584": 0, "UB 1016x305x494": 1, "UB 1016x305x438": 2, "UB 1016x305x415": 3, "UB 1016x305x393": 4, "UB 1016x305x350": 5, "UB 1016x305x314": 6, "UB 1016x305x272": 7, "UB 1016x305x249": 8, "UB 1016x305x222": 9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}, selected="UB 610x178x100": 43,
    Component="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",
    Selection=43)
toggle = BooleanToggle(True)
uc_3 = UC(
    {"UC 356x406x1299": 0, "UC 356x406x1202": 1, "UC 356x406x1086": 2, "UC 356x406x990": 3, "UC 356x406x900": 4, "UC 356x406x818": 5, "UC 356x406x744": 6, "UC 356x406x677": 7, "UC 356x406x634": 8, "UC 356x406x592": 9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}, selected="UC 356x406x1086",
    Component="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",
    Selection=2)
toggle_2 = BooleanToggle(False)
item = ListItem(List=move.Geometry, Index=0, Wrap=True)  # -> Item, Item1
L_2 = L(
    {"L 200x150x18.0": 0, "L 200x150x15.0": 1, "L 200x150x12.0": 2, "L 200x100x15.0": 3, "L 200x100x12.0": 4, "L 200x100x10.0": 5, "L 150x90x15.0": 6, "L 150x90x12.0": 7, "L 150x90x10.0": 8, "L 150x75x15.0": 9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}, selected="L 200x150x18.0",
    Component="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",
    Selection=0)
ub_2 = UB(
    {"UB 1016x305x584": 0, "UB 1016x305x494": 1, "UB 1016x305x438": 2, "UB 1016x305x415": 3, "UB 1016x305x393": 4, "UB 1016x305x350": 5, "UB 1016x305x314": 6, "UB 1016x305x272": 7, "UB 1016x305x249": 8, "UB 1016x305x222": 9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}, selected="UB 1016x305x584",
    Component="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",
    Selection=0)

geo = Geometry(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)
line_5 = Line(geo)
bar = Bar(
    Line=line_5,
    Property=ub_2,
    OrientationAngle=0,
    FeaType="{ \"_t\" : \"System.Enum\", \"TypeName\" : { \"_t\" : \"System.Type\", \"Name\" : \"BH.oM.Structure.Elements.BarFEAType\" }, \"Value\" : \"Flexural\" }",
    Component="{ .Bar")

ln = Line(StartPoint="0,0,0", EndPoint="10,10,10")
L_3 = L(
    {"L 200x150x18.0": 0, "L 200x150x15.0": 1, "L 200x150x12.0": 2, "L 200x100x15.0": 3, "L 200x100x12.0": 4, "L 200x100x10.0": 5, "L 150x90x15.0": 6, "L 150x90x12.0": 7, "L 150x90x10.0": 8, "L 150x75x15.0": 9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}, selected="L 200x150x18.0",
    Component="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",
    Selection=0)
move_2 = Move(Geometry=line_5, Motion=Y)  # -> Geometry, Transform
move_3 = Move(Geometry=move_2.Geometry, Motion=Y)  # -> Geometry, Transform
move_4 = Move(Geometry=move_3.Geometry, Motion=Y)  # -> Geometry, Transform
line_6 = Line(item.Item1)

sph = Sphere(Base=PlaneXY(0, 0, 0), Radius=Slider(50, range=0..100))

constraint6dof = Constraint6DOF(X=toggle, Y=toggle, Z=toggle, Xx=toggle_2, Yy=toggle_2, Zz=toggle_2, Component="{ .Constraint6DOF")
bar_2 = Bar(
    Line=item.Item,
    OrientationAngle=0,
    FeaType="{ \"_t\" : \"System.Enum\", \"TypeName\" : { \"_t\" : \"System.Type\", \"Name\" : \"BH.oM.Structure.Elements.BarFEAType\" }, \"Value\" : \"Flexural\" }",
    Component="{ .Bar")
bar_3 = Bar(
    Line=move_3.Geometry,
    Property=chs,
    OrientationAngle=0,
    FeaType="{ \"_t\" : \"System.Enum\", \"TypeName\" : { \"_t\" : \"System.Type\", \"Name\" : \"BH.oM.Structure.Elements.BarFEAType\" }, \"Value\" : \"Flexural\" }",
    Component="{ .Bar")
bar_4 = Bar(
    Line=move_4.Geometry,
    Property=uc,
    OrientationAngle=0,
    FeaType="{ \"_t\" : \"System.Enum\", \"TypeName\" : { \"_t\" : \"System.Type\", \"Name\" : \"BH.oM.Structure.Elements.BarFEAType\" }, \"Value\" : \"Flexural\" }",
    Component="{ .Bar")
bar_5 = Bar(
    Line=ln,
    Property=L_2,
    OrientationAngle=0,
    FeaType="{ \"_t\" : \"System.Enum\", \"TypeName\" : { \"_t\" : \"System.Type\", \"Name\" : \"BH.oM.Structure.Elements.BarFEAType\" }, \"Value\" : \"Flexural\" }",
    Component="{ .Bar")  # disabled
bar_6 = Bar(
    Line=move_2.Geometry,
    Property=L,
    OrientationAngle=0,
    FeaType="{ \"_t\" : \"System.Enum\", \"TypeName\" : { \"_t\" : \"System.Type\", \"Name\" : \"BH.oM.Structure.Elements.BarFEAType\" }, \"Value\" : \"Flexural\" }",
    Component="{ .Bar")
bar_7 = Bar(
    Line=line_4,
    Property=L_3,
    OrientationAngle=0,
    FeaType="{ \"_t\" : \"System.Enum\", \"TypeName\" : { \"_t\" : \"System.Type\", \"Name\" : \"BH.oM.Structure.Elements.BarFEAType\" }, \"Value\" : \"Flexural\" }",
    Component="{ .Bar")
bar_8 = Bar(
    Line=line_2,
    Property=ub,
    OrientationAngle=0,
    FeaType="{ \"_t\" : \"System.Enum\", \"TypeName\" : { \"_t\" : \"System.Type\", \"Name\" : \"BH.oM.Structure.Elements.BarFEAType\" }, \"Value\" : \"Flexural\" }",
    Component="{ .Bar")
bar_9 = Bar(
    Line=line_3,
    Property=uc_3,
    OrientationAngle=0,
    FeaType="{ \"_t\" : \"System.Enum\", \"TypeName\" : { \"_t\" : \"System.Type\", \"Name\" : \"BH.oM.Structure.Elements.BarFEAType\" }, \"Value\" : \"Flexural\" }",
    Component="{ .Bar")
bar_10 = Bar(
    Line=line,
    Property=uc_2,
    OrientationAngle=0,
    FeaType="{ \"_t\" : \"System.Enum\", \"TypeName\" : { \"_t\" : \"System.Type\", \"Name\" : \"BH.oM.Structure.Elements.BarFEAType\" }, \"Value\" : \"Flexural\" }",
    Component="{ .Bar")
node = Node(
    Position=pt,
    Orientation="{ \"_t\" : \"BH.oM.Geometry.Basis\", \"X\" : { \"_t\" : \"BH.oM.Geometry.Vector\", \"X\" : 1.0, \"Y\" : 0.0, \"Z\" : 0.0 }, \"Y\" : { \"_t\" : \"BH.oM.Geometry.Vector\", \"X\" : 0.0, \"Y\" : 1.0, \"Z\" : 0.0 }, \"Z\" : { \"_t\" : \"BH.oM.Geometry.Vector\", \"X\" : 0.0, \"Y\" : 0.0, \"Z\" : 1.0 } }",
    Support=constraint6dof,
    Component="BH.oM.Structure.Elements.Node")
explode = Explode(Object=bar_2, Component="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")  # -> StartNode, EndNode, SectionProperty, OrientationAngle, Release, FEAType, Support, Offset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
dam = DataDam(DataA=Slider(9, range=0..10), BufferDelay=10000000, BufferMode=2)
data = Data([bar, bar_6, bar_3, bar_4, bar_5])
bar_11 = Bar(
    Line=line_5,
    Property=ub_2,
    OrientationAngle=0,
    FeaType="{ \"_t\" : \"System.Enum\", \"TypeName\" : { \"_t\" : \"System.Type\", \"Name\" : \"BH.oM.Structure.Elements.BarFEAType\" }, \"Value\" : \"Flexural\" }",
    Component="{ .Bar")
division = Division(A=dam, B=2)
division_2 = Division(A=dam, B=2)
createcustom = CreateCustom(x=mesh, y=mesh, z=bar, Component="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")
dam_2 = DataDam(DataA=data, BufferDelay=10000000, BufferMode=0)
explode_2 = Explode(Object=explode.StartNode, Component="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")  # -> Position, Orientation, Support, BHoM_Guid, Name, Fragments, Tags, CustomData
explode_3 = Explode(Object=explode.EndNode, Component="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")  # -> Position, Orientation, Support, BHoM_Guid, Name, Fragments, Tags, CustomData
neg = Negative(Value=division)
pt_2 = ConstructPoint(XCoordinate=division, YCoordinate=division_2, ZCoordinate=dam)
createcustom_2 = CreateCustom(x=mesh, y=mesh, z=createcustom, u=bar, Component="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")
pt_3 = ConstructPoint(XCoordinate=neg, YCoordinate=division_2, ZCoordinate=dam)
uc_4 = UC(
    {"UC 356x406x1299": 0, "UC 356x406x1202": 1, "UC 356x406x1086": 2, "UC 356x406x990": 3, "UC 356x406x900": 4, "UC 356x406x818": 5, "UC 356x406x744": 6, "UC 356x406x677": 7, "UC 356x406x634": 8, "UC 356x406x592": 9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}, selected="UC 356x406x1086",
    Component="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",
    Selection=2)

# ----
# Enable/disable
# - history (enabled by default)
# - "diffing by GUID" (disabled by default)
createtype = CreateType(Component="System.Object")
createtype_2 = CreateType(Component="System.String")
createdictionary = CreateDictionary(
    Keys=["EnableHistory", "UseGUIDS"],
    Values=[Toggle(True), Toggle(False)],
    KeyType=createtype_2,
    ValueType=createtype,
    Component="{ .CreateDictionary")

line_7 = Line(Start=explode_2.Position, End=explode_3.Position, Infinite=False, Component="BH.oM.Geometry.Line")
ln_2 = Line(StartPoint=pt_3, EndPoint=pt_2)
line_8 = Line(line_6)
X = UnitX(Factor=Slider(3, range=0..10))
panel = Panel("4,8,3")
panel_2 = Panel("5,8,3")
bar_12 = Bar(
    Line=ln_2,
    OrientationAngle=0,
    FeaType="{ \"_t\" : \"System.Enum\", \"TypeName\" : { \"_t\" : \"System.Type\", \"Name\" : \"BH.oM.Structure.Elements.BarFEAType\" }, \"Value\" : \"Flexural\" }",
    Component="{ .Bar")
move_5 = Move(Geometry="3,5,6", Motion=X)  # -> Geometry, Transform
panel_3 = Panel("1,2,4")
merge = Merge(Data1=bar_10, Data2=bar_8, Data3=bar_9, Data4=node, Data5=bar_7, Data6=line_7, Data7=line_8)
node_2 = Node(Position="8,9,5", Component="BH.oM.Environment.Elements.Node")
toggle_3 = BooleanToggle(True)
toggle_4 = BooleanToggle(False)
constraint6dof_2 = Constraint6DOF(X=toggle_3, Y=toggle_3, Z=toggle_3, Xx=toggle_4, Yy=toggle_4, Zz=toggle_4, Component="{ .Constraint6DOF")
constraint6dof_3 = Constraint6DOF(X=toggle_3, Y=toggle_3, Z=toggle_3, Xx=toggle_3, Yy=toggle_3, Zz=toggle_3, Component="{ .Constraint6DOF")
explode_4 = Explode(Object=bar_12, Component="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")  # -> StartNode, EndNode, SectionProperty, OrientationAngle, Release, FEAType, Support, Offset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
node_3 = Node(
    Position=move_5.Geometry,
    Orientation="{ \"_t\" : \"BH.oM.Geometry.Basis\", \"X\" : { \"_t\" : \"BH.oM.Geometry.Vector\", \"X\" : 1.0, \"Y\" : 0.0, \"Z\" : 0.0 }, \"Y\" : { \"_t\" : \"BH.oM.Geometry.Vector\", \"X\" : 0.0, \"Y\" : 1.0, \"Z\" : 0.0 }, \"Z\" : { \"_t\" : \"BH.oM.Geometry.Vector\", \"X\" : 0.0, \"Y\" : 0.0, \"Z\" : 1.0 } }",
    Support=constraint6dof_3,
    Component="BH.oM.Structure.Elements.Node")
uc_5 = UC(
    {"UC 356x406x1299": 0, "UC 356x406x1202": 1, "UC 356x406x1086": 2, "UC 356x406x990": 3, "UC 356x406x900": 4, "UC 356x406x818": 5, "UC 356x406x744": 6, "UC 356x406x677": 7, "UC 356x406x634": 8, "UC 356x406x592": 9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}, selected="UC 356x406x509": 11,
    Component="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",
    Selection=11)
ln_3 = Line(StartPoint="3,5,6", EndPoint=move_5.Geometry)
node_4 = Node(
    Position="3,5,6",
    Orientation="{ \"_t\" : \"BH.oM.Geometry.Basis\", \"X\" : { \"_t\" : \"BH.oM.Geometry.Vector\", \"X\" : 1.0, \"Y\" : 0.0, \"Z\" : 0.0 }, \"Y\" : { \"_t\" : \"BH.oM.Geometry.Vector\", \"X\" : 0.0, \"Y\" : 1.0, \"Z\" : 0.0 }, \"Z\" : { \"_t\" : \"BH.oM.Geometry.Vector\", \"X\" : 0.0, \"Y\" : 0.0, \"Z\" : 1.0 } }",
    Support=constraint6dof_2,
    Component="BH.oM.Structure.Elements.Node")
uc_6 = UC(
    {"UC 356x406x1299": 0, "UC 356x406x1202": 1, "UC 356x406x1086": 2, "UC 356x406x990": 3, "UC 356x406x900": 4, "UC 356x406x818": 5, "UC 356x406x744": 6, "UC 356x406x677": 7, "UC 356x406x634": 8, "UC 356x406x592": 9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}, selected="UC 356x406x509": 11,
    Component="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",
    Selection=11)
line_9 = Line(Start=explode_4.StartNode, End=explode_4.EndNode, Infinite=False, Component="BH.oM.Geometry.Line")
bar_13 = Bar(
    Line=ln_3,
    Property=uc_5,
    OrientationAngle=0,
    FeaType="{ \"_t\" : \"System.Enum\", \"TypeName\" : { \"_t\" : \"System.Type\", \"Name\" : \"BH.oM.Structure.Elements.BarFEAType\" }, \"Value\" : \"Flexural\" }",
    Component="{ .Bar")
bar_14 = Bar(
    StartNode=node_4,
    EndNode=node_3,
    SectionProperty=uc_6,
    OrientationAngle=0,
    FEAType="{ \"_t\" : \"System.Enum\", \"TypeName\" : { \"_t\" : \"System.Type\", \"Name\" : \"BH.oM.Structure.Elements.BarFEAType\" }, \"Value\" : \"Flexural\" }",
    Component="BH.oM.Structure.Elements.Bar")

# ----
# Set up Speckle Adapter
speckle_he_alessio_lo = Accounts(email="alessio.lombardi@burohappold.com", restapi="https://hestia.speckle.works/api/v1")
anonymous_stream = DataSender(manualmode=False, remotecontroller=False)  # -> Log, StreamId
speckleadapter = SpeckleAdapter(SpeckleAccount=speckle_he_alessio_lo, SpeckleStreamId=anonymous_stream.StreamId, Component="{ ..ctor")
speckleadapter_2 = Data(speckleadapter)

# ----
# Verify if you are writing "History" or not
# = if the pushConfig EnableHistory is true,
# the total number of streams in the account
# will increase.
speckleaccount = Data(speckle_he_alessio_lo)
streams = Streams(Account=speckleaccount)
item_2 = ListItem(List=streams, Index=0, Wrap=True)  # -> Item1, Item
lng = ListLength(List=streams)
panel_4 = Panel(lng)
eo = ExpandObject(Object=item_2.Item)  # -> StreamId, Name, Description, Tags, Objects, Layers, BaseProperties, GlobalMeasures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
eo_2 = ExpandObject(Object=item_2.Item1)  # -> StreamId, Name, Description, Tags, Objects, Layers, BaseProperties, GlobalMeasures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
dam_3 = DataDam(DataA=eo_2.StreamId, BufferDelay=10000000, BufferMode=0)
panel_5 = Panel(eo.Children)
panel_6 = Panel(eo.Name)
panel_7 = Panel(eo.StreamId)
panel_8 = Panel(eo_2.Name)
panel_9 = Panel(eo_2.StreamId)
panel_10 = Panel(dam_3)

# ----
# Push (upload)
toggle_5 = BooleanToggle(True)
speckleadapter_3 = Data(speckleadapter_2)
push = Push(
    Adapter=speckleadapter_3,
    Objects=flatten(merge),
    PushType="{ \"_t\" : \"System.Enum\", \"TypeName\" : { \"_t\" : \"System.Type\", \"Name\" : \"BH.oM.Adapter.PushType\" }, \"Value\" : \"AdapterDefault\" }",
    Active=toggle_5,
    Component="{ .Push")  # -> Objects, Success
panel_11 = Panel(push.Objects)

item_3 = ListItem(List=flatten(push.Objects), Index=0, Wrap=True)  # -> Item, Item1, Item2, Item3
explode_5 = Explode(Object=item_3.Item, Component="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")  # -> StartNode, EndNode, SectionProperty, OrientationAngle, Release, FEAType, Support, Offset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
explode_6 = Explode(Object=explode_5.CustomData, Component="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")

panel_12 = Panel(explode_6)

# ----
# Pull (download)
speckleadapter_4 = Data(speckleadapter_2)
pull = Pull(
    Adapter=speckleadapter_4,
    PullType="{ \"_t\" : \"System.Enum\", \"TypeName\" : { \"_t\" : \"System.Type\", \"Name\" : \"BH.oM.Adapter.PullType\" }, \"Value\" : \"AdapterDefault\" }",
    Active=push.Success,
    Component="{ .Pull")
panel_13 = Panel(pull)

item_4 = ListItem(List=flatten(pull), Index=0, Wrap=True)  # -> Item, Item1, Item2, Item3
item_5 = ListItem(List=item_4.Item, Index=0, Wrap=True)
explode_7 = Explode(Object=item_5, Component="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")  # -> StartNode, EndNode, SectionProperty, OrientationAngle, Release, FEAType, Support, Offset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
explode_8 = Explode(Object=explode_7.CustomData, Component="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")  # -> Speckle_StreamId, Speckle_id
panel_14 = Panel(explode_8.Speckle_StreamId)
panel_15 = Panel(explode_8.Speckle_id)

filterbyspeckleguid = FilterBySpeckleGUID(Objects=pull, SpeckleGUIDs=panel_15, Component="{ .FilterBySpeckleGUID")
