# Grasshopper definition #86-NoDependancyOnRhino-SupportForCustomMesh.gh (Grasshopper 1.0.7)
# plug-ins: UserDataUtils, BH.UI.Grasshopper

# ----
# Initial set-up
# 1. Perform Speckle Log-in
# Right click the component, select an existing account or enter your credentials.
speckle_he_alessio_lo = Accounts(email="alessio.lombardi@burohappold.com", restapi="https://hestia.speckle.works/api/v1")
speckleaccount = Data(speckle_he_alessio_lo)

# ----
# Right click menu options
# - "View Stream" to open up a browser tab with the SpeckleViewer.
#     SpeckleViewer can be used to display the data you send.
# 
# - "View stream data" opens a browser tab with the JSON representation of the stream data.
anonymous_stream = DataSender(DebouncingDisabled=False, manualmode=False, remotecontroller=False)  # -> Log, StreamId
specklestreamid = Text(anonymous_stream.StreamId)

# ----
# 2. Set up Speckle Stream
# The Data Sender ("Anonymous stream") component here provides access to a stream.
# 
# If you want your own stream, drop a new Speckle "Data Sender" component.
panel = Panel(specklestreamid)

specklestreamid_2 = Text(specklestreamid)

# ----
# 3. Set up Speckle Adapter
# SpeckleAdapter is configured to Push/Pull to/from a specific "SpeckleStream"
# owned by a specific "SpeckleAccount".
speckleaccount_2 = Data(speckleaccount)
speckleadapter = SpeckleAdapter(SpeckleAccount=speckleaccount_2, SpeckleStreamId=specklestreamid_2, Component="{ ..ctor")
speckleadapter_2 = Data(speckleadapter)

toggle = BooleanToggle(True)
toggle_2 = BooleanToggle(False)
constraint6dof = Constraint6DOF(X=toggle, Y=toggle, Z=toggle, Xx=toggle_2, Yy=toggle_2, Zz=toggle_2, Component="{ .Constraint6DOF")
node = Node(Position="3,3,3", Support=constraint6dof, Component="{ .Node")
bhom_structural_node = Data(node)

# ----
# BHoM Mesh
number_slider = Slider(100, range=0..100)
pop2d = Populate2D(Region={Plane=PlaneXY(0, 0, 0), Size=Domain2(u=0..20, v=0..10)}, Count=number_slider, Seed=1)
dom = ConstructDomain(DomainStart=0, DomainEnd=Slider(5, range=0..10))
random = Random(Range=dom, Number=number_slider, Seed=2)
Z = UnitZ(Factor=random)
move = Move(Geometry=pop2d, Motion=Z)  # -> Geometry, Transform
del = DelaunayMesh(Points=move.Geometry, Plane=PlaneXY(0, 0, 0))
bbox = BoundingBox(Content=move.Geometry, Plane=PlaneXY(0, 0, 0), UnionBox=True)  # -> Box, Box_2
demesh = DeconstructMesh(Mesh=del)  # -> Vertices, Faces, Colours, Normals
boxprop = BoxProperties(Box=bbox.Box)  # -> Center, Diagonal, Area, Volume, Degeneracy
mesh = Mesh(Vertices=demesh.Vertices, Faces=demesh.Faces, Component="{ .Mesh")
scale = Scale(Geometry=mesh, Center=boxprop.Center, Factor=Slider(0.5, range=0..1))  # -> Geometry, Transform
example_bhom_mesh = Data(scale.Geometry)

# ----
# BHoM Line
panel_2 = Panel("10,10,10")
# Example BHoM geometries (IGeometry)
panel_3 = Panel("5,5,0")
line = Line(Start=panel_3, End=panel_2, Infinite=False, Component="BH.oM.Geometry.Line")
example_line_iobject = Data(line)

# ----
# Prepare your data
# Example Sphere (Grasshopper Geometry)
number_slider_2 = Slider(0.8, range=0..3)
sph = Sphere(Base=PlaneXY(0, 0, 0), Radius=number_slider_2)
gh_sphere = Data(sph)

# ----
# CustomObject
panel_4 = Panel("testY")
createcustom = CreateCustom(x="testX", y=panel_4, Component="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")
customobject = Data(createcustom)

bbox_2 = BoundingBox(Content=gh_sphere, Plane=PlaneXY(0, 0, 0))  # -> Box, Box_2
bhom_structural_node_2 = Data(bhom_structural_node)
customobject_2 = Data(customobject)

# ----
# (Optional) Speckle Push configurations
# Enable/disable
# - history (enabled by default)
# - "diffing by GUID" (disabled by default)
toggle_3 = BooleanToggle(True)
representationoptions = RepresentationOptions(
    Detailed0DElements=Toggle(True),
    Element0DScale=1,
    Detailed1DElements=toggle_3,
    Element1DScale=1,
    Cap1DElements=False,
    Detailed2DElements=False,
    Component="BH.oM.Graphics.RepresentationOptions")
rendermeshoptions = RenderMeshOptions(
    RepresentationOptions=representationoptions,
    Element1DRefinement=1,
    Element2DRefinement=1,
    CustomRendermeshKey="Rendermesh",
    CustomDataColorKey="Colour",
    Component="BH.oM.Graphics.RenderMeshOptions")
specklepushconfig = SpecklePushConfig(
    RendermeshOptions=rendermeshoptions,
    EnableHistory=Toggle(True),
    UseSpeckleSerialiser=False,
    UniqueRandomHash=Toggle(True),
    DiffConfig="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",
    WrapNonBHoMObjects=False,
    AllowHashForComparing=False,
    Component="BH.oM.Speckle.SpecklePushConfig")

# ----
# Simple Portal Frame
# Once pushed, go in SpeckleViewer, click the Layers icon, then look for:
# "BHoM.properties.SectionProperty.properties.Name"
# to color the objects by section property.
line_2 = Line(Line((0, -5, 0), (0, -5, 10)))
line_3 = Line([Line((0, -5, 10), (0, 5, 0)), Line((0, -5, 0), (0, 5, 10))])
line_4 = Line(Line((0, 5, 0), (0, 5, 10)))
line_5 = Line(Line((0, -5, 10), (0, 5, 10)))
uc = UC(
    {"UC 356x406x1299": 0, "UC 356x406x1202": 1, "UC 356x406x1086": 2, "UC 356x406x990": 3, "UC 356x406x900": 4, "UC 356x406x818": 5, "UC 356x406x744": 6, "UC 356x406x677": 7, "UC 356x406x634": 8, "UC 356x406x592": 9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}, selected="UC 356x406x1086",
    Component="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",
    Selection=2)
ub = UB(
    {"UB 1016x305x584": 0, "UB 1016x305x494": 1, "UB 1016x305x438": 2, "UB 1016x305x415": 3, "UB 1016x305x393": 4, "UB 1016x305x350": 5, "UB 1016x305x314": 6, "UB 1016x305x272": 7, "UB 1016x305x249": 8, "UB 1016x305x222": 9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}, selected="UB 610x178x100": 43,
    Component="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",
    Selection=43)
uc_2 = UC(
    {"UC 356x406x1299": 0, "UC 356x406x1202": 1, "UC 356x406x1086": 2, "UC 356x406x990": 3, "UC 356x406x900": 4, "UC 356x406x818": 5, "UC 356x406x744": 6, "UC 356x406x677": 7, "UC 356x406x634": 8, "UC 356x406x592": 9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}, selected="UC 356x406x1086",
    Component="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",
    Selection=2)
L = L(
    {"L 200x150x18.0": 0, "L 200x150x15.0": 1, "L 200x150x12.0": 2, "L 200x100x15.0": 3, "L 200x100x12.0": 4, "L 200x100x10.0": 5, "L 150x90x15.0": 6, "L 150x90x12.0": 7, "L 150x90x10.0": 8, "L 150x75x15.0": 9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}, selected="L 200x150x18.0",
    Component="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",
    Selection=0)
bar = Bar(
    Line=line_4,
    Property=uc_2,
    OrientationAngle=0,
    FeaType="{ \"_t\" : \"System.Enum\", \"TypeName\" : { \"_t\" : \"System.Type\", \"Name\" : \"BH.oM.Structure.Elements.BarFEAType\" }, \"Value\" : \"Flexural\" }",
    Component="{ .Bar")
bar_2 = Bar(
    Line=line_5,
    Property=ub,
    OrientationAngle=0,
    FeaType="{ \"_t\" : \"System.Enum\", \"TypeName\" : { \"_t\" : \"System.Type\", \"Name\" : \"BH.oM.Structure.Elements.BarFEAType\" }, \"Value\" : \"Flexural\" }",
    Component="{ .Bar")
bar_3 = Bar(
    Line=line_3,
    Property=L,
    OrientationAngle=0,
    FeaType="{ \"_t\" : \"System.Enum\", \"TypeName\" : { \"_t\" : \"System.Type\", \"Name\" : \"BH.oM.Structure.Elements.BarFEAType\" }, \"Value\" : \"Flexural\" }",
    Component="{ .Bar")
bar_4 = Bar(
    Line=line_2,
    Property=uc,
    OrientationAngle=0,
    FeaType="{ \"_t\" : \"System.Enum\", \"TypeName\" : { \"_t\" : \"System.Type\", \"Name\" : \"BH.oM.Structure.Elements.BarFEAType\" }, \"Value\" : \"Flexural\" }",
    Component="{ .Bar")

toggle_4 = BooleanToggle(True)
toggle_5 = BooleanToggle(False)
constraint6dof_2 = Constraint6DOF(X=toggle_4, Y=toggle_4, Z=toggle_4, Xx=toggle_5, Yy=toggle_5, Zz=toggle_5, Component="{ .Constraint6DOF")
setsupport = SetSupport(bar=[bar_4, bar], startnodesupport=constraint6dof_2)  # -> bar_w_supp_nodes, start_nodes, end_nodes

merge = Merge(Data1=bar_4, Data2=bar, Data3=setsupport.start_nodes, Data4=bar_2, Data5=bar_3)
portal_frame = Data(merge)

createtype = CreateType(Component="BH.oM.Structure.Elements.Bar")
testdataoftype = TestDataOfType(Type=createtype, Component="{ .TestDataOfType")  # -> SetNames, SetData
panel_5 = Panel(testdataoftype.SetNames)
bang = ExplodeTree(Data=testdataoftype.SetData)  # -> Branch0, Branch1, Branch2, Branch3, Branch4, Branch5, Branch6, Branch7, Branch8
merge_2 = Merge(
    Data1=bang.Branch0,
    Data2=bang.Branch1,
    Data3=bang.Branch2,
    Data4=bang.Branch3,
    Data5=bang.Branch4,
    Data6=bang.Branch5,
    Data7=bang.Branch6,
    Data8=bang.Branch7)

split = SplitList(List=flatten(merge_2), Index=Slider(90, range=0..500))  # -> ListA, ListB

testset_bars_many = Data(split.ListA)

example_line_iobject_2 = Data(example_line_iobject)
testset_bars_many_2 = Data(testset_bars_many)
portal_frame_2 = Data(portal_frame)
example_bhom_mesh_2 = Data(example_bhom_mesh)
gh_sphere_2 = Data(gh_sphere)
merge_3 = Merge(Data1=portal_frame_2)
data_to_be_sent = Data(testset_bars_many_2)

# ----
# Push (upload)
data_to_be_sent_2 = Data(data_to_be_sent)
# Push your data
speckleadapter_3 = Data(speckleadapter_2)
dam = DataDam(DataA=data_to_be_sent_2, BufferDelay=2500000, BufferMode=2)
push = Push(
    Adapter=speckleadapter_3,
    Objects=flatten(dam),
    PushType="{ \"_t\" : \"System.Enum\", \"TypeName\" : { \"_t\" : \"System.Type\", \"Name\" : \"BH.oM.Adapter.PushType\" }, \"Value\" : \"AdapterDefault\" }",
    ActionConfig=specklepushconfig,
    Active=Toggle(True),
    Component="{ .Push")  # -> Objects, Success
push_succeded_bool = Boolean(push.Success)
panel_6 = Panel(push.Objects)

# ---- group: Try the "revisions"
# This attaches a text "revision1", "revision2", etc under the bhomObjects' CustomData["Revision"].
# In Speckle you can group by customdata.revision.
data_to_be_sent_3 = Data(data_to_be_sent)
lng = ListLength(List=data_to_be_sent_3)
split_2 = SplitList(List=data_to_be_sent_3, Index=expr("x/2", lng))  # -> ListA, ListB
cluster = Cluster(data=split_2.ListB, txt="revision2")
cluster_2 = Cluster(data=split_2.ListA, txt="revision1")
data = Data(cluster_2)
merge_4 = Merge(Data1=data, Data2=cluster)

# ----
# (Optional) Check CustomData
# Speckle Stream Id is stored in BHoMObject CustomData.
# Note that, by design, the object are not returned with their SpeckleId stored in their CustomData unless you use the Pull.
item = ListItem(List=flatten(push.Objects), Index=0, Wrap=True)  # -> Item, Item1, Item2, Item3
explode = Explode(Object=item.Item1, Component="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")  # -> StartNode, EndNode, SectionProperty, OrientationAngle, Release, FEAType, Support, Offset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
explode_2 = Explode(Object=explode.CustomData, Component="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")
panel_7 = Panel(explode_2)

# ----
# Pull (download)
# Users can Pull from another script,
# if their SpeckleAdapter is configured with the same SpeckleStreamId
# and a SpeckleAccount with read permissions.
toggle_6 = BooleanToggle(True)
push_succeded_bool_2 = Boolean(push_succeded_bool)
# Pull from Speckle
speckleadapter_4 = Data(speckleadapter_2)
and = GateAnd(A=push_succeded_bool_2, B=toggle_6)
pull = Pull(
    Adapter=speckleadapter_4,
    PullType="{ \"_t\" : \"System.Enum\", \"TypeName\" : { \"_t\" : \"System.Type\", \"Name\" : \"BH.oM.Adapter.PullType\" }, \"Value\" : \"AdapterDefault\" }",
    Active=and,
    Component="{ .Pull")
panel_8 = Panel(pull)

explode_3 = Explode(Object=pull, Component="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")  # -> StartNode, EndNode, SectionProperty, OrientationAngle, Release, FEAType, Support, Offset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

# ----
# (Optional) Check CustomData
# Objects are returned with their SpeckleId stored in their CustomData
# when using the Pull.
item_2 = ListItem(List=flatten(pull), Index=0, Wrap=True)  # -> Item, Item1, Item2, Item3
item_3 = ListItem(List=item_2.Item, Index=0, Wrap=True)
explode_4 = Explode(Object=item_3, Component="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")  # -> StartNode, EndNode, SectionProperty, OrientationAngle, Release, FEAType, Support, Offset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
explode_5 = Explode(Object=explode_4.CustomData, Component="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")  # -> Speckle_StreamId, Speckle_id
panel_9 = Panel(explode_5.Speckle_StreamId)
panel_10 = Panel(explode_5.Speckle_id)

# ----
# (Optional) Filter objects
filterbyspeckleguid = FilterBySpeckleGUID(Objects=pull, SpeckleIds=panel_10, SpeckleAdapterIdName="Speckle_id", Component="{ .FilterBySpeckleGUID")

# ==== cluster SetSupport
startnodesupport = ClusterInput()  # Constraint6DOF
toggle = BooleanToggle(False)
bar = ClusterInput()
endnodesupport = ClusterInput()  # Constraint6DOF
constraint6dof = Constraint6DOF(X=toggle, Y=toggle, Z=toggle, Xx=toggle, Yy=toggle, Zz=toggle, Component="{ .Constraint6DOF")
c_script = CSharpScript(x=startnodesupport, y=constraint6dof)  # -> A
# ---------- c_script: C# ----------
    A = x == null ? y : x;
# ---------- end c_script ----------

bar_2 = Data(bar)
getproperty = GetProperty(Obj=bar_2, PropName="StartNode", Component="{ .GetProperty")
setproperty = SetProperty(Obj=getproperty, PropName="Support", Value=c_script, Component="{ .PropertyValue")
setproperty_2 = SetProperty(Obj=bar_2, PropName="StartNode", Value=setproperty, Component="{ .PropertyValue")

c_script_2 = CSharpScript(x=endnodesupport, y=constraint6dof)  # -> A; same code as c_script

constraint6dof_2 = Data(c_script_2)
getproperty_2 = GetProperty(Obj=setproperty_2, PropName="EndNode", Component="{ .GetProperty")
setproperty_3 = SetProperty(Obj=getproperty_2, PropName="Support", Value=constraint6dof_2, Component="{ .PropertyValue")
setproperty_4 = SetProperty(Obj=setproperty_2, PropName="EndNode", Value=setproperty_3, Component="{ .PropertyValue")

explode = Explode(Object=setproperty_4, Component="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")  # -> StartNode, EndNode, SectionProperty, OrientationAngle, Release, FEAType, Support, Offset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
end_nodes = ClusterOutput(explode.EndNode)  # End nodes
start_nodes = ClusterOutput(explode.StartNode)  # Start nodes

bar_w_supp_nodes = ClusterOutput(setproperty_4)  # Bar w/ supp nodes

# ==== cluster Cluster
txt = ClusterInput()
data = ClusterInput()
txt_2 = Text(txt)
data_2 = Data(data)
createtype = CreateType(Component="System.Object")
createdictionary = CreateDictionary(Keys="RevisionName", Values=txt_2, ValueType=createtype, Component="{ .CreateDictionary")
setproperty = SetProperty(Obj=data_2, PropName="CustomData", Value=createdictionary, Component="{ .PropertyValue")
result = ClusterOutput(setproperty)
